% Simulink data dictionary green_joint_current_loop_interface.sldd

T_GJFloat = Simulink.AliasType(BaseType="single", DataScope="Exported", HeaderFile="green_joint_current_loop_types.h")  % Generic float-first green-joint controller scalar.
T_GJCurrent = Simulink.AliasType(BaseType="single", DataScope="Exported", HeaderFile="green_joint_current_loop_types.h")  % Dq current in amperes.
T_GJVoltage = Simulink.AliasType(BaseType="single", DataScope="Exported", HeaderFile="green_joint_current_loop_types.h")  % Physical voltage command in volts.
T_GJVoltageNorm = Simulink.AliasType(BaseType="single", DataScope="Exported", HeaderFile="green_joint_current_loop_types.h")  % Voltage vector normalized to the unit circle for downstream modulation.

green_joint_current_loop_input_t = Simulink.Bus(DataScope="Exported", HeaderFile="green_joint_current_loop_types.h")
  id_ref: T_GJCurrent, Unit="A"  % D-axis current command.
  iq_ref: T_GJCurrent, Unit="A"  % Q-axis current command.
  id_fbk: T_GJCurrent, Unit="A"  % Filtered D-axis current feedback supplied by firmware.
  iq_fbk: T_GJCurrent, Unit="A"  % Filtered Q-axis current feedback supplied by firmware.
  vbus: T_GJVoltage, Min=0, Unit="V"  % DC bus voltage used to derive the circular Vdq limit.

green_joint_current_loop_output_t = Simulink.Bus(DataScope="Exported", HeaderFile="green_joint_current_loop_types.h")
  vd_cmd: T_GJVoltage, Unit="V"  % D-axis physical voltage command after Vd-priority clamp.
  vq_cmd: T_GJVoltage, Unit="V"  % Q-axis physical voltage command limited by voltage remaining after Vd is preserved.
  voltage_mag: T_GJVoltage, Unit="V"  % Magnitude of clamped Vdq command.
  vd_norm: T_GJVoltageNorm, Unit="1"  % D-axis voltage normalized by the usable current-loop voltage limit.
  vq_norm: T_GJVoltageNorm, Unit="1"  % Q-axis voltage normalized by the usable current-loop voltage limit.
  voltage_mag_norm: T_GJVoltageNorm, Min=0, Max=1, Unit="1"  % Magnitude normalized by the usable current-loop voltage limit, clamped to the unit circle.
  vd_mod: T_GJVoltageNorm, Unit="1"  % D-axis normalized voltage command relative to the SVPWM linear base limit. Feed this to the legacy inverse Park/SVGEN path.
  vq_mod: T_GJVoltageNorm, Unit="1"  % Q-axis normalized voltage command relative to the SVPWM linear base limit. Feed this to the legacy inverse Park/SVGEN path.
  voltage_mag_mod: T_GJVoltageNorm, Min=0, Max=1, Unit="1"  % Magnitude relative to the SVPWM linear base limit. Maximum is VoltageModulationRatio.

CurDKp = Simulink.Parameter(1.52320723148, StorageClass="ExportedGlobal", DataType="T_GJFloat", Unit="V/A")  % D-axis current-loop proportional gain. Default contract tracks green_joint_1615_config.json.
CurDKi = Simulink.Parameter(23812.2981754, StorageClass="ExportedGlobal", DataType="T_GJFloat", Unit="V/(A*s)")  % D-axis current-loop integral gain. Default contract tracks green_joint_1615_config.json.
CurQKp = Simulink.Parameter(1.52320723148, StorageClass="ExportedGlobal", DataType="T_GJFloat", Unit="V/A")  % Q-axis current-loop proportional gain. Default contract tracks green_joint_1615_config.json.
CurQKi = Simulink.Parameter(23812.2981754, StorageClass="ExportedGlobal", DataType="T_GJFloat", Unit="V/(A*s)")  % Q-axis current-loop integral gain. Default contract tracks green_joint_1615_config.json.
PiCorrectionGain = Simulink.Parameter(400, StorageClass="ExportedGlobal", DataType="T_GJFloat", Unit="1/s")  % Back-calculation anti-windup gain for circular voltage saturation.
VoltageLimitRatio = Simulink.Parameter(0.577, StorageClass="ExportedGlobal", DataType="T_GJFloat", Min=0, Max=1, Unit="1")  % SVPWM linear Vdq base limit as a ratio of DC bus voltage. Usable PI voltage limit is VoltageLimitRatio * VoltageModulationRatio * vbus.
VoltageModulationRatio = Simulink.Parameter(0.9, StorageClass="ExportedGlobal", DataType="T_GJFloat", Min=0, Max=1, Unit="1")  % Usable fraction of the SVPWM linear base limit. This participates in physical PI voltage saturation and defines the maximum vd_mod/vq_mod magnitude.
VoltageEpsilon = Simulink.Parameter(0.001, StorageClass="ExportedGlobal", DataType="T_GJVoltage", Min=0, Unit="V")  % Small positive denominator guard for voltage normalization.