% Simulink data dictionary green_joint_average_motor_twin_interface.sldd
% references green_joint_current_loop_interface.sldd
% references speed_pi_interface.sldd
% references speed_estimator_pll_interface.sldd
% references green_joint_mit_impedance_interface.sldd

T_MotorFloat = Simulink.AliasType(BaseType="single", DataScope="Exported", HeaderFile="green_joint_average_motor_twin_types.h")
T_MotorVoltage = Simulink.AliasType(BaseType="single", DataScope="Exported", HeaderFile="green_joint_average_motor_twin_types.h")
T_MotorAngle = Simulink.AliasType(BaseType="single", DataScope="Exported", HeaderFile="green_joint_average_motor_twin_types.h")
T_MotorCurrent = Simulink.AliasType(BaseType="single", DataScope="Exported", HeaderFile="green_joint_average_motor_twin_types.h")
T_MotorSpeed = Simulink.AliasType(BaseType="single", DataScope="Exported", HeaderFile="green_joint_average_motor_twin_types.h")
T_MotorTorque = Simulink.AliasType(BaseType="single", DataScope="Exported", HeaderFile="green_joint_average_motor_twin_types.h")
T_DutyRatio = Simulink.AliasType(BaseType="single", DataScope="Exported", HeaderFile="green_joint_average_motor_twin_types.h")

motor_t = Simulink.Bus(DataScope="Exported", HeaderFile="green_joint_average_motor_twin_types.h")
  ia: T_MotorCurrent
  ib: T_MotorCurrent
  ic: T_MotorCurrent
  theta_e: T_MotorAngle

motor_dq_t = Simulink.Bus(DataScope="Exported", HeaderFile="green_joint_average_motor_twin_types.h")
  i_alpha: T_MotorCurrent
  i_beta: T_MotorCurrent
  id: T_MotorCurrent
  iq: T_MotorCurrent

open_loop_cmd_t = Simulink.Bus(DataScope="Exported", HeaderFile="green_joint_average_motor_twin_types.h")
  vd: T_MotorVoltage
  vq: T_MotorVoltage
  theta_e: T_MotorAngle
  vdc: T_MotorVoltage

phase_duty_t = Simulink.Bus(DataScope="Exported", HeaderFile="green_joint_average_motor_twin_types.h")
  da: T_DutyRatio
  db: T_DutyRatio
  dc: T_DutyRatio