% Simulink data dictionary green_joint_mit_impedance_interface.sldd

T_GJMitFlag = Simulink.AliasType(BaseType="uint8", DataScope="Exported", HeaderFile="green_joint_mit_impedance_types.h")
T_GJMitFloat = Simulink.AliasType(BaseType="single", DataScope="Exported", HeaderFile="green_joint_mit_impedance_types.h")
T_GJMitAngle = Simulink.AliasType(BaseType="single", DataScope="Exported", HeaderFile="green_joint_mit_impedance_types.h")
T_GJMitSpeed = Simulink.AliasType(BaseType="single", DataScope="Exported", HeaderFile="green_joint_mit_impedance_types.h")
T_GJMitTorque = Simulink.AliasType(BaseType="single", DataScope="Exported", HeaderFile="green_joint_mit_impedance_types.h")
T_GJMitCurrent = Simulink.AliasType(BaseType="single", DataScope="Exported", HeaderFile="green_joint_mit_impedance_types.h")
T_GJMitGain = Simulink.AliasType(BaseType="single", DataScope="Exported", HeaderFile="green_joint_mit_impedance_types.h")

green_joint_mit_input_t = Simulink.Bus(DataScope="Exported", HeaderFile="green_joint_mit_impedance_types.h")
  pos_target_rad: T_GJMitAngle
  pos_feedback_rad: T_GJMitAngle
  vel_target_rad_s: T_GJMitSpeed
  vel_feedback_rad_s: T_GJMitSpeed
  ff_torque_nm: T_GJMitTorque
  kp_nm_per_rad: T_GJMitGain
  kd_nm_s_per_rad: T_GJMitGain
  torque_to_iq_gain_a_per_nm: T_GJMitGain
  iq_limit_a: T_GJMitCurrent

green_joint_mit_output_t = Simulink.Bus(DataScope="Exported", HeaderFile="green_joint_mit_impedance_types.h")
  iq_ref_a: T_GJMitCurrent

GJMitPi = Simulink.Parameter(3.141593, DataType="T_GJMitAngle")
GJMitTwoPi = Simulink.Parameter(6.283185, DataType="T_GJMitAngle")
KpDefaultNmPerRad = Simulink.Parameter(11.79547, DataType="T_GJMitGain")
KdDefaultNmSPerRad = Simulink.Parameter(0.2393318, DataType="T_GJMitGain")
TorqueToIqGainDefault = Simulink.Parameter(1.054379, DataType="T_GJMitGain")
IqLimitDefaultA = Simulink.Parameter(4, DataType="T_GJMitCurrent")