% Simulink data dictionary motor_interface.sldd

T_MotorCurrent = Simulink.NumericType(DataTypeMode="Fixed-point: binary point scaling", SignednessBool=true, WordLength=16, FixedExponent=-12, DataScope="Exported", HeaderFile="motor_types.h")
T_MotorAngle = Simulink.AliasType(BaseType="single", DataScope="Exported", HeaderFile="motor_types.h")

motor_t = Simulink.Bus(DataScope="Exported", HeaderFile="motor_types.h")
  ia: T_MotorCurrent
  ib: T_MotorCurrent
  ic: T_MotorCurrent
  theta_e: T_MotorAngle

motor_dq_t = Simulink.Bus(DataScope="Exported", HeaderFile="motor_types.h")
  i_alpha: T_MotorCurrent
  i_beta: T_MotorCurrent
  id: T_MotorCurrent
  iq: T_MotorCurrent