% Simulink data dictionary motor_control_interface.sldd

T_MotorFloat = Simulink.AliasType(BaseType="single", DataScope="Exported", HeaderFile="motor_control_types.h")
T_MotorVoltage = Simulink.AliasType(BaseType="single", DataScope="Exported", HeaderFile="motor_control_types.h")
T_MotorAngle = Simulink.AliasType(BaseType="single", DataScope="Exported", HeaderFile="motor_control_types.h")
T_MotorCurrent = Simulink.AliasType(BaseType="single", DataScope="Exported", HeaderFile="motor_control_types.h")
T_MotorSpeed = Simulink.AliasType(BaseType="single", DataScope="Exported", HeaderFile="motor_control_types.h")
T_MotorTorque = Simulink.AliasType(BaseType="single", DataScope="Exported", HeaderFile="motor_control_types.h")
T_DutyRatio = Simulink.AliasType(BaseType="single", DataScope="Exported", HeaderFile="motor_control_types.h")
T_CurrentPiFloat = Simulink.AliasType(BaseType="single", DataScope="Exported", HeaderFile="motor_control_types.h")
T_CurrentPiCurrent = Simulink.AliasType(BaseType="single", DataScope="Exported", HeaderFile="motor_control_types.h")
T_CurrentPiVoltage = Simulink.AliasType(BaseType="single", DataScope="Exported", HeaderFile="motor_control_types.h")
T_CurrentPiSpeed = Simulink.AliasType(BaseType="single", DataScope="Exported", HeaderFile="motor_control_types.h")
T_CurrentPiGain = Simulink.AliasType(BaseType="single", DataScope="Exported", HeaderFile="motor_control_types.h")
T_SpeedPiFloat = Simulink.AliasType(BaseType="single", DataScope="Exported", HeaderFile="motor_control_types.h")
T_SpeedPiSpeed = Simulink.AliasType(BaseType="single", DataScope="Exported", HeaderFile="motor_control_types.h")
T_SpeedPiCurrent = Simulink.AliasType(BaseType="single", DataScope="Exported", HeaderFile="motor_control_types.h")
T_SpeedPiGain = Simulink.AliasType(BaseType="single", DataScope="Exported", HeaderFile="motor_control_types.h")
T_DeadtimeCompDuty = Simulink.AliasType(BaseType="single", DataScope="Exported", HeaderFile="motor_control_types.h")
T_DeadtimeCompCurrent = Simulink.AliasType(BaseType="single", DataScope="Exported", HeaderFile="motor_control_types.h")
T_DeadtimeCompTrig = Simulink.AliasType(BaseType="single", DataScope="Exported", HeaderFile="motor_control_types.h")
T_DeadtimeCompBool = Simulink.AliasType(BaseType="boolean", DataScope="Exported", HeaderFile="motor_control_types.h")

motor_t = Simulink.Bus(DataScope="Exported", HeaderFile="motor_control_types.h")
  ia: T_MotorCurrent
  ib: T_MotorCurrent
  ic: T_MotorCurrent
  theta_e: T_MotorAngle

motor_dq_t = Simulink.Bus(DataScope="Exported", HeaderFile="motor_control_types.h")
  i_alpha: T_MotorCurrent
  i_beta: T_MotorCurrent
  id: T_MotorCurrent
  iq: T_MotorCurrent

open_loop_cmd_t = Simulink.Bus(DataScope="Exported", HeaderFile="motor_control_types.h")
  vd: T_MotorVoltage
  vq: T_MotorVoltage
  theta_e: T_MotorAngle
  vdc: T_MotorVoltage

phase_duty_t = Simulink.Bus(DataScope="Exported", HeaderFile="motor_control_types.h")
  da: T_DutyRatio
  db: T_DutyRatio
  dc: T_DutyRatio

plant_feedback_t = Simulink.Bus(DataScope="Exported", HeaderFile="motor_control_types.h")
  ia: T_MotorCurrent
  ib: T_MotorCurrent
  ic: T_MotorCurrent
  wm: T_MotorSpeed
  theta_m: T_MotorAngle
  theta_e: T_MotorAngle

current_pi_input_t = Simulink.Bus(DataScope="Exported", HeaderFile="motor_control_types.h")
  id_ref: T_CurrentPiCurrent
  iq_ref: T_CurrentPiCurrent
  id_meas: T_CurrentPiCurrent
  iq_meas: T_CurrentPiCurrent
  omega_e: T_CurrentPiSpeed
  vdc: T_CurrentPiVoltage

current_pi_output_t = Simulink.Bus(DataScope="Exported", HeaderFile="motor_control_types.h")
  vd_ref: T_CurrentPiVoltage
  vq_ref: T_CurrentPiVoltage

speed_pi_input_t = Simulink.Bus(DataScope="Exported", HeaderFile="motor_control_types.h")
  wm_ref: T_SpeedPiSpeed
  wm_meas: T_SpeedPiSpeed
  iq_limit: T_SpeedPiCurrent

speed_pi_output_t = Simulink.Bus(DataScope="Exported", HeaderFile="motor_control_types.h")
  iq_ref: T_SpeedPiCurrent

pwm_deadtime_comp_input_t = Simulink.Bus(DataScope="Exported", HeaderFile="motor_control_types.h")
  da: T_DeadtimeCompDuty
  db: T_DeadtimeCompDuty
  dc: T_DeadtimeCompDuty
  id: T_DeadtimeCompCurrent
  iq: T_DeadtimeCompCurrent
  sin_theta_e: T_DeadtimeCompTrig
  cos_theta_e: T_DeadtimeCompTrig

pwm_deadtime_comp_output_t = Simulink.Bus(DataScope="Exported", HeaderFile="motor_control_types.h")
  da: T_DeadtimeCompDuty
  db: T_DeadtimeCompDuty
  dc: T_DeadtimeCompDuty
  comp_a: T_DeadtimeCompDuty
  comp_b: T_DeadtimeCompDuty
  comp_c: T_DeadtimeCompDuty
  active_a: T_DeadtimeCompBool
  active_b: T_DeadtimeCompBool
  active_c: T_DeadtimeCompBool

Kp_id = Simulink.Parameter(1.332035, DataType="T_CurrentPiGain")
Ki_id = Simulink.Parameter(1072.4140625, DataType="T_CurrentPiGain")
Kaw_id = Simulink.Parameter(400, DataType="T_CurrentPiGain")
Kp_iq = Simulink.Parameter(1.332035, DataType="T_CurrentPiGain")
Ki_iq = Simulink.Parameter(1072.4140625, DataType="T_CurrentPiGain")
Kaw_iq = Simulink.Parameter(400, DataType="T_CurrentPiGain")
VLimitRatio = Simulink.Parameter(0.577, DataType="T_CurrentPiGain")
Kp_speed = Simulink.Parameter(0.6309257, DataType="T_SpeedPiGain")
Ki_speed = Simulink.Parameter(79.28446, DataType="T_SpeedPiGain")
Kaw_speed = Simulink.Parameter(40, DataType="T_SpeedPiGain")
IqLimitDefault = Simulink.Parameter(15, DataType="T_SpeedPiCurrent")
simcfg = struct(stop_time=0.06, Ts_plant=2.5e-5, Ts_ctrl=5.0e-5, Ts_speed=0.0001)
current_pi_simcfg = struct(Ts_ctrl=5.0e-5)
speed_pi_simcfg = struct(Ts_speed=0.0001)
inverter = struct(Vdc=68, load_torque=0, current_limit=15)
openloop = struct(vd=single(0), vq=single(8), freq_hz=single(20))
DeadtimeCompEnable = Simulink.Parameter(1, DataType="T_DeadtimeCompBool")
DeadtimeCompDuty = Simulink.Parameter(0.01, DataType="T_DeadtimeCompDuty")
DeadtimeCompCurrentZero_A = Simulink.Parameter(0.02, DataType="T_DeadtimeCompCurrent")
DeadtimeCompCurrentFull_A = Simulink.Parameter(0.1, DataType="T_DeadtimeCompCurrent")
DeadtimeCompCurrentInvRange_1perA = Simulink.Parameter(12.5, DataType="T_DeadtimeCompDuty")
DeadtimeCompPolarity = Simulink.Parameter(-1, DataType="T_DeadtimeCompDuty")