% Simulink data dictionary current_filter_interface.sldd

T_CurrentFilterReal = Simulink.AliasType(BaseType="single", DataScope="Exported", HeaderFile="current_filter_types.h")
T_CurrentFilterCurrent = Simulink.AliasType(BaseType="single", DataScope="Exported", HeaderFile="current_filter_types.h")
T_CurrentFilterAlpha = Simulink.AliasType(BaseType="single", DataScope="Exported", HeaderFile="current_filter_types.h")

current_filter_input_t = Simulink.Bus(DataScope="Exported", HeaderFile="current_filter_types.h")
  id_raw: T_CurrentFilterCurrent
  iq_raw: T_CurrentFilterCurrent
  v_mag_norm: T_CurrentFilterReal

current_filter_output_t = Simulink.Bus(DataScope="Exported", HeaderFile="current_filter_types.h")
  id_f: T_CurrentFilterCurrent
  iq_f: T_CurrentFilterCurrent
  alpha: T_CurrentFilterAlpha