% Simulink data dictionary current_pi_interface.sldd

T_CurrentPiFloat = Simulink.AliasType(BaseType="single", DataScope="Exported", HeaderFile="current_pi_types.h")
T_CurrentPiCurrent = Simulink.AliasType(BaseType="single", DataScope="Exported", HeaderFile="current_pi_types.h")
T_CurrentPiVoltage = Simulink.AliasType(BaseType="single", DataScope="Exported", HeaderFile="current_pi_types.h")
T_CurrentPiSpeed = Simulink.AliasType(BaseType="single", DataScope="Exported", HeaderFile="current_pi_types.h")
T_CurrentPiGain = Simulink.AliasType(BaseType="single", DataScope="Exported", HeaderFile="current_pi_types.h")

current_pi_input_t = Simulink.Bus(DataScope="Exported", HeaderFile="current_pi_types.h")
  id_ref: T_CurrentPiCurrent
  iq_ref: T_CurrentPiCurrent
  id_meas: T_CurrentPiCurrent
  iq_meas: T_CurrentPiCurrent
  omega_e: T_CurrentPiSpeed
  vdc: T_CurrentPiVoltage

current_pi_output_t = Simulink.Bus(DataScope="Exported", HeaderFile="current_pi_types.h")
  vd_ref: T_CurrentPiVoltage
  vq_ref: T_CurrentPiVoltage

Kp_id = Simulink.Parameter(1.332035, DataType="T_CurrentPiGain")
Ki_id = Simulink.Parameter(1072.4140625, DataType="T_CurrentPiGain")
Kaw_id = Simulink.Parameter(400, DataType="T_CurrentPiGain")
Kp_iq = Simulink.Parameter(1.332035, DataType="T_CurrentPiGain")
Ki_iq = Simulink.Parameter(1072.4140625, DataType="T_CurrentPiGain")
Kaw_iq = Simulink.Parameter(400, DataType="T_CurrentPiGain")
VLimitRatio = Simulink.Parameter(0.577, DataType="T_CurrentPiGain")