% Simulink data dictionary motor_float_interface.sldd

T_MotorFloat = Simulink.AliasType(BaseType="single", DataScope="Exported", HeaderFile="motor_float_types.h")
T_MotorVoltage = Simulink.AliasType(BaseType="single", DataScope="Exported", HeaderFile="motor_float_types.h")
T_MotorAngle = Simulink.AliasType(BaseType="single", DataScope="Exported", HeaderFile="motor_float_types.h")
T_MotorCurrent = Simulink.AliasType(BaseType="single", DataScope="Exported", HeaderFile="motor_float_types.h")
T_MotorSpeed = Simulink.AliasType(BaseType="single", DataScope="Exported", HeaderFile="motor_float_types.h")
T_MotorTorque = Simulink.AliasType(BaseType="single", DataScope="Exported", HeaderFile="motor_float_types.h")
T_DutyRatio = Simulink.AliasType(BaseType="single", DataScope="Exported", HeaderFile="motor_float_types.h")

open_loop_cmd_t = Simulink.Bus(DataScope="Exported", HeaderFile="motor_float_types.h")
  vd: T_MotorVoltage
  vq: T_MotorVoltage
  theta_e: T_MotorAngle
  vdc: T_MotorVoltage

phase_duty_t = Simulink.Bus(DataScope="Exported", HeaderFile="motor_float_types.h")
  da: T_DutyRatio
  db: T_DutyRatio
  dc: T_DutyRatio

dc_bus_t = Simulink.Bus(DataScope="Exported", HeaderFile="motor_float_types.h")
  vdc: T_MotorVoltage

plant_feedback_t = Simulink.Bus(DataScope="Exported", HeaderFile="motor_float_types.h")
  ia: T_MotorCurrent
  ib: T_MotorCurrent
  ic: T_MotorCurrent
  wm: T_MotorSpeed
  theta_m: T_MotorAngle
  theta_e: T_MotorAngle