% Simulink data dictionary speed_estimator_pll_interface.sldd

T_SpeedEstimatorFloat = Simulink.AliasType(BaseType="single", DataScope="Exported", HeaderFile="speed_estimator_pll_types.h")
T_SpeedEstimatorAngle = Simulink.AliasType(BaseType="single", DataScope="Exported", HeaderFile="speed_estimator_pll_types.h")
T_SpeedEstimatorSpeed = Simulink.AliasType(BaseType="single", DataScope="Exported", HeaderFile="speed_estimator_pll_types.h")
T_SpeedEstimatorGain = Simulink.AliasType(BaseType="single", DataScope="Exported", HeaderFile="speed_estimator_pll_types.h")
T_SpeedEstimatorReset = Simulink.AliasType(BaseType="uint8", DataScope="Exported", HeaderFile="speed_estimator_pll_types.h")

speed_estimator_input_t = Simulink.Bus(DataScope="Exported", HeaderFile="speed_estimator_pll_types.h")
  motor_angle_rad: T_SpeedEstimatorAngle
  reset: T_SpeedEstimatorReset

speed_estimator_output_t = Simulink.Bus(DataScope="Exported", HeaderFile="speed_estimator_pll_types.h")
  joint_speed_est_rad_s: T_SpeedEstimatorSpeed
  motor_speed_mech_rad_s: T_SpeedEstimatorSpeed
  motor_speed_elec_rad_s: T_SpeedEstimatorSpeed
  theta_hat_rad: T_SpeedEstimatorAngle

PllKp = Simulink.Parameter(4523.894, DataType="T_SpeedEstimatorGain")
PllKi = Simulink.Parameter(5116403, DataType="T_SpeedEstimatorGain")
SpeedEstimatorSampleTime = Simulink.Parameter(5e-05, DataType="T_SpeedEstimatorFloat")
GearRatio = Simulink.Parameter(183.35, DataType="T_SpeedEstimatorFloat")
InvGearRatio = Simulink.Parameter(0.005454049, DataType="T_SpeedEstimatorFloat")
PolePairs = Simulink.Parameter(2, DataType="T_SpeedEstimatorFloat")
EncoderOffsetRad = Simulink.Parameter(0, DataType="T_SpeedEstimatorAngle")
ZeroSpeedThresholdRadS = Simulink.Parameter(0.01226322, DataType="T_SpeedEstimatorSpeed")