% Simulink data dictionary speed_pi_interface.sldd

T_SpeedPiFloat = Simulink.AliasType(BaseType="single", DataScope="Exported", HeaderFile="speed_pi_types.h")
T_SpeedPiSpeed = Simulink.AliasType(BaseType="single", DataScope="Exported", HeaderFile="speed_pi_types.h")
T_SpeedPiCurrent = Simulink.AliasType(BaseType="single", DataScope="Exported", HeaderFile="speed_pi_types.h")
T_SpeedPiGain = Simulink.AliasType(BaseType="single", DataScope="Exported", HeaderFile="speed_pi_types.h")

speed_pi_input_t = Simulink.Bus(DataScope="Exported", HeaderFile="speed_pi_types.h")
  wm_ref: T_SpeedPiSpeed
  wm_meas: T_SpeedPiSpeed
  iq_limit: T_SpeedPiCurrent

speed_pi_output_t = Simulink.Bus(DataScope="Exported", HeaderFile="speed_pi_types.h")
  iq_ref: T_SpeedPiCurrent

Kp_speed = Simulink.Parameter(0.3403194, DataType="T_SpeedPiGain")
Ki_speed = Simulink.Parameter(22.11002, DataType="T_SpeedPiGain")
Kaw_speed = Simulink.Parameter(125.6637, DataType="T_SpeedPiGain")
IqLimitDefault = Simulink.Parameter(0.1, DataType="T_SpeedPiCurrent")