% Simulink data dictionary pwm_deadtime_compensation_interface.sldd

T_DeadtimeCompDuty = Simulink.AliasType(BaseType="single", DataScope="Exported", HeaderFile="pwm_deadtime_compensation_types.h")
T_DeadtimeCompCurrent = Simulink.AliasType(BaseType="single", DataScope="Exported", HeaderFile="pwm_deadtime_compensation_types.h")
T_DeadtimeCompTrig = Simulink.AliasType(BaseType="single", DataScope="Exported", HeaderFile="pwm_deadtime_compensation_types.h")
T_DeadtimeCompBool = Simulink.AliasType(BaseType="boolean", DataScope="Exported", HeaderFile="pwm_deadtime_compensation_types.h")

pwm_deadtime_comp_input_t = Simulink.Bus(DataScope="Exported", HeaderFile="pwm_deadtime_compensation_types.h")
  da: T_DeadtimeCompDuty
  db: T_DeadtimeCompDuty
  dc: T_DeadtimeCompDuty
  id: T_DeadtimeCompCurrent
  iq: T_DeadtimeCompCurrent
  sin_theta_e: T_DeadtimeCompTrig
  cos_theta_e: T_DeadtimeCompTrig

pwm_deadtime_comp_output_t = Simulink.Bus(DataScope="Exported", HeaderFile="pwm_deadtime_compensation_types.h")
  da: T_DeadtimeCompDuty
  db: T_DeadtimeCompDuty
  dc: T_DeadtimeCompDuty
  comp_a: T_DeadtimeCompDuty
  comp_b: T_DeadtimeCompDuty
  comp_c: T_DeadtimeCompDuty
  active_a: T_DeadtimeCompBool
  active_b: T_DeadtimeCompBool
  active_c: T_DeadtimeCompBool

DeadtimeCompEnable = Simulink.Parameter(1, DataType="T_DeadtimeCompBool")
DeadtimeCompDuty = Simulink.Parameter(0.01, DataType="T_DeadtimeCompDuty")
DeadtimeCompCurrentZero_A = Simulink.Parameter(0.02, DataType="T_DeadtimeCompCurrent")
DeadtimeCompCurrentFull_A = Simulink.Parameter(0.1, DataType="T_DeadtimeCompCurrent")
DeadtimeCompCurrentInvRange_1perA = Simulink.Parameter(12.5, DataType="T_DeadtimeCompDuty")
DeadtimeCompPolarity = Simulink.Parameter(-1, DataType="T_DeadtimeCompDuty")