% Simulink data dictionary pwm_deadtime_sampling_interface.sldd

T_PwmSamplingFloat = Simulink.AliasType(BaseType="single", DataScope="Exported", HeaderFile="pwm_deadtime_sampling_types.h")
T_PwmDuty = Simulink.AliasType(BaseType="single", DataScope="Exported", HeaderFile="pwm_deadtime_sampling_types.h")
T_PwmTime = Simulink.AliasType(BaseType="single", DataScope="Exported", HeaderFile="pwm_deadtime_sampling_types.h")
T_PwmSampleValid = Simulink.AliasType(BaseType="boolean", DataScope="Exported", HeaderFile="pwm_deadtime_sampling_types.h")

pwm_phase_duty_t = Simulink.Bus(DataScope="Exported", HeaderFile="pwm_deadtime_sampling_types.h")
  da: T_PwmDuty
  db: T_PwmDuty
  dc: T_PwmDuty

pwm_sampling_status_t = Simulink.Bus(DataScope="Exported", HeaderFile="pwm_deadtime_sampling_types.h")
  ideal_low_a_s: T_PwmTime
  ideal_low_b_s: T_PwmTime
  ideal_low_c_s: T_PwmTime
  usable_low_a_s: T_PwmTime
  usable_low_b_s: T_PwmTime
  usable_low_c_s: T_PwmTime
  sample_valid_a: T_PwmSampleValid
  sample_valid_b: T_PwmSampleValid
  sample_valid_c: T_PwmSampleValid
  all_samples_valid: T_PwmSampleValid
  min_usable_low_s: T_PwmTime

PwmPeriod_s = Simulink.Parameter(5e-05, DataType="T_PwmTime")
DeadTimeTotal_s = Simulink.Parameter(1e-06, DataType="T_PwmTime")
AdcSettleTime_s = Simulink.Parameter(1e-06, DataType="T_PwmTime")
MinValidWindow_s = Simulink.Parameter(2.5e-06, DataType="T_PwmTime")