% Simulink data dictionary add_interface.sldd

T_AddIn = Simulink.AliasType(BaseType="int16", DataScope="Exported", HeaderFile="add_types.h")
T_AddOut = Simulink.AliasType(BaseType="int16", DataScope="Exported", HeaderFile="add_types.h")
T_AddAcc = Simulink.AliasType(BaseType="int16", DataScope="Exported", HeaderFile="add_types.h")